# Grasshopper definition Parametric_Shelves.gh (Grasshopper 1.0.7)

# ----
# Starting Line
# Start Parameter:0
# End Parameter: 1
lenght_of_furniture = Slider(1.3, range=0..2)
construct_point = ConstructPoint(XCoordinate=0, YCoordinate=0, ZCoordinate=0)
construct_point_2 = ConstructPoint(XCoordinate=lenght_of_furniture, YCoordinate=0, ZCoordinate=0)
gene_pool = GenePool(Decimals=2, Maximum=1, Minimum=0, Value=[0, 0.1833333333, 0.4, 0.59, 1])
line = Line(StartPoint=construct_point, EndPoint=construct_point_2)
evaluate_curve = EvaluateCurve(Curve=line, Parameter=gene_pool)  # -> Point, Tangent, Angle

# ----
# Curve 03
list_length = ListLength(List=evaluate_curve.Point)
deconstruct = Deconstruct(Point=evaluate_curve.Point)  # -> XComponent, YComponent, ZComponent
construct_domain = ConstructDomain(DomainStart=0, DomainEnd=1)
subtraction = Subtraction(A=list_length, B=1)
range = Range(Domain=construct_domain, Steps=subtraction)
graph_mapper = GraphMapper(
    range,
    x0=0,
    x1=1,
    y0=0,
    y1=1,
    container_name="Bezier",
    cpx=[0, 0.3730385602, 0.4264664948, 1],
    cpy=[0.4565712214, 0.1252673864, 0.5541585684, 0.3368243575])
construct_point_3 = ConstructPoint(XCoordinate=deconstruct.XComponent, YCoordinate=graph_mapper, ZCoordinate=Slider(0, range=0..1.2))
interpolate = Interpolate(Vertices=construct_point_3, Degree=3, Periodic=False, KnotStyle=1)  # -> Curve, Length, Domain

# ----
# Curve 02
list_length_2 = ListLength(List=evaluate_curve.Point)
deconstruct_2 = Deconstruct(Point=evaluate_curve.Point)  # -> XComponent, YComponent, ZComponent
construct_domain_2 = ConstructDomain(DomainStart=0, DomainEnd=1)
subtraction_2 = Subtraction(A=list_length_2, B=1)
range_2 = Range(Domain=construct_domain_2, Steps=subtraction_2)
number_slider = Slider(1.1, range=0..1.2)
graph_mapper_2 = GraphMapper(
    range_2,
    x0=0,
    x1=1,
    y0=0,
    y1=1,
    container_name="Bezier",
    cpx=[0, 0.3929554224, 0.655145824, 1],
    cpy=[0.476780057, 0.158883214, 0.126686573, 0.499387145])
construct_point_4 = ConstructPoint(XCoordinate=deconstruct_2.XComponent, YCoordinate=graph_mapper_2, ZCoordinate=number_slider)
interpolate_2 = Interpolate(Vertices=construct_point_4, Degree=3, Periodic=False, KnotStyle=1)  # -> Curve, Length, Domain

# ----
# Curve 01
deconstruct_3 = Deconstruct(Point=evaluate_curve.Point)  # -> XComponent, YComponent, ZComponent
list_length_3 = ListLength(List=evaluate_curve.Point)
subtraction_3 = Subtraction(A=list_length_3, B=1)
construct_domain_3 = ConstructDomain(DomainStart=0, DomainEnd=1)
range_3 = Range(Domain=construct_domain_3, Steps=subtraction_3)
graph_mapper_3 = GraphMapper(
    range_3,
    x0=0,
    x1=1,
    y0=0,
    y1=1,
    container_name="Bezier",
    cpx=[0, 0.325711906, 0.6008300781, 1],
    cpy=[0.6188545227, 0.2226481438, 0.5903903246, 0.3219056129])
construct_point_5 = ConstructPoint(XCoordinate=deconstruct_3.XComponent, YCoordinate=graph_mapper_3, ZCoordinate=Slider(0.5, range=0..1.2))
interpolate_3 = Interpolate(Vertices=construct_point_5, Degree=3, Periodic=False, KnotStyle=1)  # -> Curve, Length, Domain

# ----
# Extrude line to construction height
unit_z = UnitZ(Factor=number_slider)
extrude = Extrude(Base=line, Direction=unit_z)

# ----
# Closest and Farthest from Surface
panel = Panel([construct_point_5, construct_point_4, construct_point_3])
point = Point(panel)
surface_closest_point = SurfaceClosestPoint(Point=point, Surface=extrude)  # -> Point, UVPoint, Distance
list_length_4 = ListLength(List=point)
subtraction_4 = Subtraction(A=list_length_4, B="1")
sort_list = SortList(Keys=surface_closest_point.Distance, ValuesValuesA=point)  # -> Keys, ValuesValuesA
list_item = ListItem(List=sort_list.ValuesValuesA, Index=0, Wrap=True)
list_item_2 = ListItem(List=sort_list.ValuesValuesA, Index=subtraction_4, Wrap=True)
deconstruct_4 = Deconstruct(Point=list_item)  # -> XComponent, YComponent, ZComponent
deconstruct_5 = Deconstruct(Point=list_item_2)  # -> XComponent, YComponent, ZComponent

loft = Loft(
    Curves=[interpolate_2.Curve, interpolate_3.Curve, interpolate.Curve],
    Options={Adjust=False, Closed=False, LoftEnds=0, LoftSimp=0, LoftType=0, Rebuild=10, Refit=0.01})

# ----
# Moving Factor
subtraction_5 = Subtraction(A=deconstruct_5.YComponent, B=deconstruct_4.YComponent)
division = Division(A=subtraction_5, B="2")
addition = Addition(A=deconstruct_4.YComponent, B=division)
negative = Negative(Value=addition)
unit_y = UnitY(Factor=negative)

# ----
# Back Cutter
approximate_depth_of_construction = Slider(0.4, range=0..1)
unit_y_2 = UnitY(Factor=approximate_depth_of_construction)
move = Move(Geometry=extrude, Motion=unit_y_2)  # -> Geometry, Transform

brep = Brep(move.Geometry)

move_2 = Move(Geometry=loft, Motion=unit_y)  # -> Geometry, Transform
unit_y_3 = UnitY(Factor=1)
extrude_2 = Extrude(Base=move_2.Geometry, Direction=unit_y_3)
split_brep = SplitBrep(Brep=extrude_2, Cutter=move.Geometry)
list_item_3 = ListItem(List=split_brep, Index="0", Wrap=True)
brep_join = BrepJoin(Breps=flatten([brep, list_item_3]))  # -> flatten(Breps), Closed

# ----
# Construction Of Perpendicular Frames
construct_point_6 = ConstructPoint(XCoordinate=0, YCoordinate=0, ZCoordinate=number_slider)
line_2 = Line(StartPoint=construct_point, EndPoint=construct_point_6)
starting_line = Line(line)
gene_pool_2 = GenePool(Decimals=1, Maximum=1, Minimum=0, Value=[0, 0.1818181818, 0.4545454545, 0.7, 0.8, 1])
gene_pool_3 = GenePool(Decimals=2, Maximum=1, Minimum=0, Value=[0, 0.125, 0.3, 0.55, 1])
evaluate_curve_2 = EvaluateCurve(Curve=line_2, Parameter=gene_pool_3)  # -> Point, Tangent, Angle
evaluate_curve_3 = EvaluateCurve(Curve=starting_line, Parameter=gene_pool_2)  # -> Point, Tangent, Angle
perp_frame = PerpFrame(Curve=starting_line, Parameter=gene_pool_2)
perp_frame_2 = PerpFrame(Curve=line_2, Parameter=gene_pool_3)

thickness_of_wood = Slider(0.02, range=0..1)

# ----
# Vertical Perps
brep_plane = BrepPlane(Brep=brep_join.Breps, Plane=perp_frame_2, UseTasks=True)  # -> flatten(Curves), Points

# ----
# Horizontal Perps
brep_plane_2 = BrepPlane(Brep=brep_join.Breps, Plane=perp_frame, UseTasks=True)  # -> flatten(Curves), Points

# ----
# Negative: Extrusion to bottom
# Positive: Extrusion to top
multiplication = Multiplication(A=evaluate_curve_2.Tangent, B=thickness_of_wood)

boundary_surfaces = BoundarySurfaces(Edges=brep_plane_2.Curves)
boundary_surfaces_2 = BoundarySurfaces(Edges=brep_plane.Curves)
multiplication_2 = Multiplication(A=evaluate_curve_3.Tangent, B=thickness_of_wood)

unit_z_2 = UnitZ(Factor=thickness_of_wood)
unit_x = UnitX(Factor=thickness_of_wood)
negative_2 = Negative(Value=unit_x)
negative_3 = Negative(Value=unit_z_2)
multiplication_3 = Multiplication(A=negative_2, B="0.5")
multiplication_4 = Multiplication(A=negative_3, B="0.5")

# ----
# Horizontal Breps
extrude_3 = Extrude(Base=boundary_surfaces, Direction=multiplication_2)
move_3 = Move(Geometry=extrude_3, Motion=multiplication_3)  # -> Geometry, Transform

# ----
# Vertical Breps
extrude_4 = Extrude(Base=boundary_surfaces_2, Direction=multiplication)
move_4 = Move(Geometry=extrude_4, Motion=multiplication_4)  # -> flatten(Geometry), Transform

# ----
# Edge Breps rearrange
panel_2 = Panel("1")
split_list = SplitList(List=move_4.Geometry, Index=panel_2)  # -> ListA, ListB
list_length_5 = ListLength(List=split_list.ListB)
negative_4 = Negative(Value=multiplication_4)
subtraction_6 = Subtraction(A=list_length_5, B="1")
split_list_2 = SplitList(List=split_list.ListB, Index=subtraction_6)  # -> ListA, ListB
move_5 = Move(Geometry=split_list_2.ListB, Motion=multiplication_4)  # -> Geometry, Transform
move_6 = Move(Geometry=split_list.ListA, Motion=negative_4)  # -> Geometry, Transform
brep_2 = Brep(flatten([move_6.Geometry, move_5.Geometry, split_list_2.ListA]))

cross_reference = CrossReference(ListListA=boundary_surfaces, ListListB=boundary_surfaces_2, CrossMode=1)  # -> ListListA, ListListB
brep_brep = BrepBrep(BrepA=cross_reference.ListListA, BrepB=cross_reference.ListListB)  # -> Curves, Points
negative_5 = Negative(Value=multiplication_3)
brep_curve = BrepCurve(Brep=brep, Curve=brep_brep.Curves)  # -> Curves, Points
scale = Scale(Geometry=brep_brep.Curves, Center=brep_curve.Points, Factor=Slider(0.8, range=0..1))  # -> flatten(Geometry), Transform
extrude_5 = Extrude(Base=scale.Geometry, Direction=negative_2)
move_7 = Move(Geometry=extrude_5, Motion=negative_5)  # -> Geometry, Transform
negative_6 = Negative(Value=multiplication_4)
extrude_6 = Extrude(Base=move_7.Geometry, Direction=negative_3)
move_8 = Move(Geometry=extrude_6, Motion=negative_6)  # -> Geometry, Transform

list_item_4 = ListItem(List=scale.Geometry, Index=0, Wrap=True)

solid_difference = SolidDifference(BrepsA=move_3.Geometry, BrepsB=move_8.Geometry)  # -> flatten(Result)
end_points = EndPoints(Curve=list_item_4)  # -> Start, End
bounding_box = BoundingBox(Content=solid_difference, Plane=PlaneXY(0, 0, 0))  # -> Box, Box_2
line_3 = Line(StartPoint=end_points.End, EndPoint=end_points.Start)
stretch = Stretch(Geometry=bounding_box.Box_2, Axis=line_3, Length=Slider(0.5, range=-5..2), Rigid=False)
solid_difference_2 = SolidDifference(BrepsA=stretch, BrepsB=move_3.Geometry)
solid_union = SolidUnion(Breps=flatten([solid_difference_2, solid_difference]))

merge_faces = MergeFaces(Brep=solid_union)  # -> Breps, Before, After
solid_difference_3 = SolidDifference(BrepsA=brep_2, BrepsB=merge_faces.Breps)
brep_3 = Brep([solid_difference, solid_difference_3])
